# Grasshopper definition animate-camera-camera-crane.gh (Grasshopper 1.0.7)
# plug-ins: Heteroptera

# ---- group: Inputs
run = BooleanToggle(True)
height = Slider(1700, range=0..10000)
camera_positions_count = Slider(60, range=0..1000)
circle_radius = Slider(1700, range=0..10000)
frame_position = Slider(0, range=0..1)
field_of_view = Slider(15, range=0..100)

# ---- group: Inputs / Origin
xy_plane = XYPlane(Origin=Point(0, 0, 0))
plane = Plane(xy_plane)

# ----
integer = Integer(camera_positions_count)
circle = Circle(Plane=plane, Radius=circle_radius)
division = Division(A=height, B=integer)
divide_curve = DivideCurve(Curve=circle, Count=integer, Kinks=False)  # -> Points, Tangents, Parameters
series = Series(Start=0, Step=division, Count=integer)
number = Number(frame_position)

# ---- group: Target Point
bounds = Bounds(Numbers=series)
deconstruct_domain = DeconstructDomain(Domain=bounds)  # -> Start, End
unit_z = UnitZ(Factor=deconstruct_domain.End)
move = Move(Geometry=plane, Motion=unit_z)  # -> Geometry, Transform
line = Line(StartPoint=move.Geometry, EndPoint=plane)
evaluate_curve = EvaluateCurve(Curve=line, Parameter=number)  # -> Point, Tangent, Angle

# ---- group: Location Point
unit_z_2 = UnitZ(Factor=series)
move_2 = Move(Geometry=divide_curve.Points, Motion=unit_z_2)  # -> Geometry, Transform
interpolate = Interpolate(Vertices=move_2.Geometry, Degree=3, Periodic=False, KnotStyle=1)  # -> reparameterize(Curve), Length, Domain
evaluate_curve_2 = EvaluateCurve(Curve=interpolate.Curve, Parameter=number)  # -> Point, Tangent, Angle
vector_2pt = Vector2Pt(PointA=evaluate_curve_2.Point, PointB=evaluate_curve.Point, Unitize=False)  # -> Vector, Length
plane_normal = PlaneNormal(Origin=evaluate_curve_2.Point, ZAxis=vector_2pt.Vector)

# ----
camera_crane = CameraCrane(Location=evaluate_curve_2.Point, Target=evaluate_curve.Point, Lens=field_of_view, Perspective=2, Refresh=run)  # -> Camera, Target, Lens, Up, HorizontalViewAngle, VerticalViewAngle, ScreenRatio, Frame
panel = Panel(camera_crane.Camera)

# ---- group: Preview Output / Inputs
point = Point(evaluate_curve_2.Point)
vector = Vector(vector_2pt.Vector)
geometry = Geometry(move_2.Geometry)
brep = Brep([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])
brep_2 = Brep(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)
surface = Surface(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)

# ---- group: Preview Output
orient = Orient(Geometry=brep_2, Source=plane, Target=plane_normal)  # -> Geometry, Transform
move_3 = Move(Geometry=geometry, Motion=Vector(0, 0, 32))  # -> Geometry, Transform

# ---- group: Preview Output / Colours
white = ColourSwatch(SwatchColor=RGB(255, 255, 246))
blue_500 = ColourSwatch(SwatchColor=RGB(59, 130, 246))

# ---- group: Preview Output / Rendering
custom_preview = CustomPreview(Geometry=brep, Material=blue_500)
custom_preview_2 = CustomPreview(Geometry=orient.Geometry, Material=blue_500)
custom_preview_3 = CustomPreview(Geometry=surface, Material=white)
vector_display = VectorDisplay(Anchor=point, Vector=vector)
point_list = PointList(Points=move_3.Geometry)
point_order = PointOrder(Points=geometry)
